# Grasshopper definition voronoi mesh.gh (Grasshopper 1.0.7)
# plug-ins: Weaverbird, ShapeDiverForGrasshopper

sddp = ShapeDiverDocumentPayload({AbsoluteTolerance=0, AngleTolerance=0, DistanceDisplayPrecision=0, GltfVersion="Gltf2", GrasshopperVersion="1.0.0007", InputGroups="{}", OutputGroups="{}", RelativeTolerance=0, RhinoVersion="7.35.23346.11001", UnitSystem=0, VersionCreated="1.16.0.0", VersionSaved="1.16.0.0"})
number_of_opennings = Slider(700, range=3..700)
opennings_min = Slider(0.01, range=0.01..0.99)
opennings_max = Slider(0.99, range=0.01..0.99)
rounded_or_sharp = Slider(1, range=1..3)
thickness = Slider(0.85, range=0.01..0.99)
number_of_opennings_2 = GetInteger(number_of_opennings, AtLeast=1, AtMost=1, Maximum=2147483647, Minimum=-2147483648, TreeAccess=False)
opennings_max_2 = GetNumber(opennings_max, AtLeast=1, AtMost=1, Maximum=1.797693135e+308, Minimum=-1.797693135e+308, TreeAccess=False)
opennings_min_2 = GetNumber(opennings_min, AtLeast=1, AtMost=1, Maximum=1.797693135e+308, Minimum=-1.797693135e+308, TreeAccess=False)
rounded_or_sharp_2 = GetInteger(rounded_or_sharp, AtLeast=1, AtMost=1, Maximum=2147483647, Minimum=-2147483648, TreeAccess=False)
thickness_2 = GetNumber(thickness, AtLeast=1, AtMost=1, Maximum=1.797693135e+308, Minimum=-1.797693135e+308, TreeAccess=False)
msphere = MeshSphere(Base=PlaneXY(0, 0, 0), Radius=10, UCount=10, VCount=20)
mesh = Mesh(msphere)
face_boundaries = FaceBoundaries(Mesh=mesh)
boundary_surfaces = BoundarySurfaces(Edges=face_boundaries)
brep_join = BrepJoin(Breps=boundary_surfaces)  # -> Breps, Closed
brep = Brep(brep_join.Breps)
popgeo = PopulateGeometry(Geometry=brep, Count=number_of_opennings_2, Seed=1000)
bbox = BoundingBox(Content=brep, Plane=PlaneXY(0, 0, 0))  # -> Box, Box_2
pdecon = Deconstruct(Point=popgeo)  # -> XComponent, YComponent, ZComponent
voronoi³ = Voronoi3D(Points=popgeo, Box=bbox.Box)  # -> Cells, Boundary
bbx = BrepBrep(BrepA=brep, BrepB=voronoi³.Cells)  # -> flatten(Curves), Points
bnd = Bounds(Numbers=flatten(pdecon.ZComponent))  # -> flatten(Domain)
dom = ConstructDomain(DomainStart=opennings_min_2, DomainEnd=opennings_max_2)
leave_true = BooleanToggle(True)
disc = Discontinuity(Curve=bbx.Curves, Level=1)  # -> Points, Parameters
remap = RemapNumbers(Value=pdecon.ZComponent, Source=bnd, Target=dom)  # -> reverse(Mapped), Clipped
pline = PolyLine(Vertices=disc.Points, Closed=leave_true)  # -> flatten(Polyline)
graph = GraphMapper(
    reverse(remap.Mapped),
    x0=0,
    x1=1,
    y0=0,
    y1=1,
    container_name="Bezier",
    cpx=[0, 0.25, 0.8424620628, 1],
    cpy=[0, 0.25, 0.4494681954, 1])
pcen = PolygonCenter(Polyline=pline)  # -> CenterV, CenterE, CenterA
scale = Scale(Geometry=pline, Center=pcen.CenterE, Factor=graph)  # -> flatten(Geometry), Transform
merge = Merge(Data1=graft(pline), Data2=graft(scale.Geometry))
clean_tree = CleanTree(RemoveNulls=True, RemoveInvalid=True, RemoveEmpty=False, Tree=merge)
loft = Loft(Curves=clean_tree, Options={Adjust=False, Closed=False, LoftEnds=0, LoftSimp=0, LoftType=3, Rebuild=10, Refit=0.01})
debrep = DeconstructBrep(Brep=loft)  # -> Faces, Edges, Vertices
mesh_uv = MeshSurface(Surface=debrep.Faces, UCount=rounded_or_sharp_2, VCount=rounded_or_sharp_2, Overhang=True, Equalize=False)
wbjoin = WeaverbirdsJoinMeshesAndWeld(Mesh=flatten(mesh_uv), Weld=invert(False))
wbthicken = WeaverbirdsMeshThicken(MeshCurves=wbjoin, Distance=thickness_2, OffsetType=0)
weaverbird_s_catmull_clark_subdivision = WeaverbirdsCatmullClarkSubdivision(MeshCurves=wbthicken, Level=Slider(2, range=0..10), SmoothNakedEdges=1)
preview = CustomPreview(Geometry=weaverbird_s_catmull_clark_subdivision, Material=ColourSwatch(SwatchColor=RGB(205, 69, 255)))
context_bake = ContextBake(Geometry=weaverbird_s_catmull_clark_subdivision)
