# Grasshopper definition 3d_Cellular automation Game of life_hoops setup.gh (Grasshopper 1.0.7)
# plug-ins: Kangaroo2 Components, Anemone, ShapeDiverForGrasshopper, VoxelTools

live_cell_rule = Slider(2, range=0..8)
live_cell_rule_2 = Slider(3, range=0..8)

dead_cell_rule = Slider(3, range=0..10)
voxel_size = Slider(4, range=0..10)
density_of_voxels = Slider(5.8, range=0..10)
no_of_floors = Slider(4, range=0..20)
plot_size = Slider(10, range=0..100)
grid_size = Slider(30, range=0..100)
height = Slider(8, range=0..10)
sddp = ShapeDiverDocumentPayload({AbsoluteTolerance=0, AngleTolerance=0, DistanceDisplayPrecision=0, GltfVersion="Gltf2", GrasshopperVersion="1.0.0007", InputGroups="{}", OutputGroups="{}", RelativeTolerance=0, RhinoVersion="7.34.23267.11001", UnitSystem=0, VersionCreated="1.16.0.0", VersionSaved="1.16.0.0"})
seed = GetInteger(Slider(27, range=0..100), AtLeast=1, AtMost=1, Maximum=2147483647, Minimum=-2147483648, TreeAccess=False)
voxel_size_2 = GetNumber(voxel_size, AtLeast=1, AtMost=1, Maximum=1.797693135e+308, Minimum=-1.797693135e+308, TreeAccess=False)
grid_size_2 = GetInteger(grid_size, AtLeast=1, AtMost=1, Maximum=2147483647, Minimum=-2147483648, TreeAccess=False)
live_cell_rule_a_smaller_than = GetInteger(live_cell_rule, AtLeast=1, AtMost=1, Maximum=2147483647, Minimum=-2147483648, TreeAccess=False)
live_cell_rule_b_larger_than = GetInteger(live_cell_rule_2, AtLeast=1, AtMost=1, Maximum=2147483647, Minimum=-2147483648, TreeAccess=False)
trigger = GetBoolean(Button(), AtLeast=1, AtMost=1, FalseValue="False", TreeAccess=False, TrueValue="True")
height_2 = GetInteger(height, AtLeast=1, AtMost=1, Maximum=2147483647, Minimum=-2147483648, TreeAccess=False)
no_of_floors_2 = GetInteger(no_of_floors, AtLeast=1, AtMost=1, Maximum=2147483647, Minimum=-2147483648, TreeAccess=False)
dead_cell_rule_equals = GetInteger(dead_cell_rule, AtLeast=1, AtMost=1, Maximum=2147483647, Minimum=-2147483648, TreeAccess=False)
density_of_voxels_2 = GetNumber(density_of_voxels, AtLeast=1, AtMost=1, Maximum=1.797693135e+308, Minimum=-1.797693135e+308, TreeAccess=False)
dom = ConstructDomain(DomainStart=0, DomainEnd=plot_size)
pt = Point(Point(0, 0, 0))
rectangle = Rectangle(Plane=PlaneXY(0, 0, 0), XSize=dom, YSize=dom, Radius=0)  # -> Rectangle, Length

# ---- group: vector setup
rectangle_2 = Rectangle(Plane=PlaneXY(0, 0, 0), XSize="-10 to 10", YSize="-10 to 10", Radius=0)  # -> Rectangle, Length
explode = Explode(Curve=rectangle_2.Rectangle, Recursive=True)  # -> Segments, Vertices
midpt = CurveMiddle(Curve=explode.Segments)
disc = Discontinuity(Curve=rectangle_2.Rectangle, Level=1)  # -> Points, Parameters
pt_2 = ConstructPoint(XCoordinate=0, YCoordinate=0, ZCoordinate=0)
merge = Merge(Data1=disc.Points, Data2=midpt)

# ----
arrrec = RectangularArray(Geometry=pt, Cell=rectangle.Rectangle, XCount=grid_size_2, YCount=grid_size_2)  # -> Geometry, Transform
lng = ListLength(List=arrrec.Geometry)
random = Random(Range=Domain(0, 1), Number=lng, Seed=seed, Integers=True)
cull = CullPattern(List=arrrec.Geometry, CullPattern=random)
starting_generation = Point(cull)
loop_start = LoopStart(N=no_of_floors_2, T=trigger, D0=starting_generation, D1=starting_generation)  # -> port, Counter, Data, Data_2
live_pt = Point(loop_start.Data)

vec2pt = Vector2Pt(PointA=pt_2, PointB=merge, Unitize=False)  # -> Vector, Length
live_pt_2 = Point(live_pt)
move = Move(Geometry=live_pt_2, Motion=graft(vec2pt.Vector))  # -> flatten(Geometry), Transform
duppt = RemoveDuplicatePts(Points=move.Geometry, Tolerance=0.01)
merge_2 = Merge(Data1=live_pt_2, Data2=duppt)  # -> flatten(Result)
cullpt = CullDuplicates(Points=merge_2, Tolerance=0.1, CullMode=2)  # -> Points, Indices, Valence

multiplication = Multiplication(A=loop_start.Counter, B=height_2)
addition = Addition(A=multiplication, B=height_2)

pt_3 = Point(live_pt)
rectangle_3 = Rectangle(Plane=pt_3, XSize=dom, YSize=dom, Radius=0)  # -> Rectangle, Length
incurve = PointInCurve(Point=pt_3, Curve=graft(rectangle_3.Rectangle))  # -> Relationship, Point
equals = Equality(FirstNumber=incurve.Relationship, SecondNumber="1")  # -> Equality, Inequality
ma = MassAddition(Input=equals.Equality)  # -> flatten(Result), PartialResults

dead_pt = Point(cullpt.Points)
rectangle_4 = Rectangle(Plane=dead_pt, XSize=dom, YSize=dom, Radius=0)  # -> Rectangle, Length
incurve_2 = PointInCurve(Point=live_pt, Curve=graft(rectangle_4.Rectangle))  # -> Relationship, Point
equals_2 = Equality(FirstNumber=incurve_2.Relationship, SecondNumber="1")  # -> Equality, Inequality
ma_2 = MassAddition(Input=equals_2.Equality)  # -> flatten(Result), PartialResults

tag = TextTag3D(
    Location=pt_3,
    Text=ma.Result,
    Size=Slider(4, range=0..10),
    Colour=ColourSwatch(SwatchColor=RGB(255, 255, 255)),
    Justification=7)
how_many_neighbours_each_live_point_has = Number(ma.Result)

how_many_neighbours_each_dead_point_has = Number(ma_2.Result)
equals_3 = Equality(FirstNumber=how_many_neighbours_each_dead_point_has, SecondNumber=dead_cell_rule_equals)  # -> Equality, Inequality
cull_2 = CullPattern(List=dead_pt, CullPattern=equals_3.Equality)

smaller = SmallerThan(FirstNumber=how_many_neighbours_each_live_point_has, SecondNumber=live_cell_rule_a_smaller_than)  # -> SmallerThan, OrEqualTo
larger = LargerThan(FirstNumber=how_many_neighbours_each_live_point_has, SecondNumber=live_cell_rule_b_larger_than)  # -> LargerThan, OrEqualTo
or = GateOr(A=smaller.SmallerThan, B=larger.LargerThan)
panel = Panel(or)

cull_3 = CullPattern(List=pt_3, CullPattern=invert(or))
became_alive = Point(cull_2)
stayed_alive = Point(cull_3)
Z = UnitZ(Factor=addition)
merge_3 = Merge(Data1=stayed_alive, Data2=became_alive)  # -> flatten(Result)
new_generation = Point(merge_3)
move_2 = Move(Geometry=new_generation, Motion=Z)  # -> Geometry, Transform
merge_4 = Merge(Data1=loop_start.Data_2, Data2=move_2.Geometry)
loop_end = LoopEnd(
    port=loop_start.port,
    Exit=False,
    Data=new_generation,
    Data_2=merge_4,
    TimeOutVal=0,
    pausedState=False,
    state="Constant output")  # -> D0, D1
recorded_pt = Point(loop_end.D1)
dam = DataDam(DataA=recorded_pt, BufferDelay=10000000, BufferMode=0)
pt_4 = Point(recorded_pt)
bbox = BoundingBox(Content=flatten(pt_4), Plane=PlaneXY(0, 0, 0), UnionBox=True)  # -> Box, Box_2
voxcreate = CreateVoxelGrid(BoundingBox=bbox.Box, SizeX=voxel_size_2, SizeY=voxel_size_2, SizeZ=voxel_size_2)
voxgeo = VoxelateGeometry(Geometry=pt_4, VoxelGrid=voxcreate, Distance=density_of_voxels_2)
voxmeshhull = VoxelGridToMeshHull(VoxelGrid=voxgeo, FakeShadow=False)  # -> Mesh, X, X_2, Y, Y_2, Z, Z_2
mesh = Mesh(voxmeshhull.Mesh)
context_bake = ContextBake(ReferanceGrid=arrrec.Geometry)
context_bake_2 = ContextBake(Geometry=mesh)
