# Grasshopper definition Spikey_setup.gh (Grasshopper 1.0.7)
# Spherical spikey thing

branch_length = Slider(4.55, range=0..10)
cell_radius = Slider(7.96, range=0..10)

cell_radius_2 = GetNumber(cell_radius, AtLeast=1, AtMost=1, Maximum=1.797693135e+308, Minimum=-1.797693135e+308, TreeAccess=False)
count = GetInteger(Slider(83, range=1..100), AtLeast=1, AtMost=1, Maximum=2147483647, Minimum=-2147483648, TreeAccess=False)
branch_length_2 = GetNumber(branch_length, AtLeast=1, AtMost=1, Maximum=1.797693135e+308, Minimum=-1.797693135e+308, TreeAccess=False)
pt = ConstructPoint(XCoordinate=0, YCoordinate=0, ZCoordinate=0)
msphere = MeshSphere(Base=pt, Radius=cell_radius_2, UCount=10, VCount=20)
popgeo = PopulateGeometry(Geometry=msphere, Count=count, Seed=1)
facet = FacetDome(Points=popgeo, Radius=cell_radius_2)  # -> Pattern, Dome
explode = Explode(Curve=facet.Pattern, Recursive=True)  # -> Segments, Vertices
curvepoint = PointOnCurve(explode.Segments, parameter=0.5)
avr = Average(Input=curvepoint)
lng = ListLength(List=explode.Segments)
vec2pt = Vector2Pt(PointA=pt, PointB=avr, Unitize=invert(False))  # -> Vector, Length
amp = Amplitude(Vector=vec2pt.Vector, Amplitude=branch_length_2)
addition = Addition(A=avr, B=amp)
end = EndPoints(Curve=graft(explode.Segments))  # -> Start, End
dup = DuplicateData(Data=addition, Number=lng, Order=True)
pshift = ShiftPaths(Data=dup, Offset=-1)  # -> graft(Data)
merge = Merge(Data1=end.Start, Data2=end.End, Data3=pshift)
triangle = MeshTriangle(CornerA=0, CornerB=1, CornerC=2)
conmesh = ConstructMesh(Vertices=merge, Faces=triangle)
mjoin = MeshJoin(Meshes=flatten(conmesh))
alignvert = AlignVertices(Mesh=mjoin, Tolerance=0.1)  # -> Result, Count
weld = WeldMesh(Mesh=alignvert.Result, Angle=3.141592654)
subdmesh = SubDFromMesh(Mesh=weld, Creases=1, Corners=1, Interpolate=False)
subd = SubD(subdmesh)
context_bake = ContextBake(Geometry=subd)

# ---- group: RH_OUT:SubD
subd_2 = SubD(subd)  # disabled
