# Grasshopper definition Peanuts3.gh (Grasshopper 1.0.7)
# plug-ins: Human, NGon, Kangaroo2 Components, LunchBox, MetaHopper

number_slider = Slider(-4, range=-4..4)

# ---- group: Synclastic/antisynclastic surface
point = Point(Point(0, 29.9618409, 0))
point_2 = Point(Point(30.03954, 0, 0))
point_3 = Point(Point(0, 0, 0))
distance = Distance(PointA=point_3, PointB=point_2)
distance_2 = Distance(PointA=point_3, PointB=point)
absolute = Absolute(Value=number_slider)
addition = Addition(A=distance, B=absolute)
addition_2 = Addition(A=distance_2, B=absolute)
unit_z = UnitZ(Factor=absolute)
unit_z_2 = UnitZ(Factor=number_slider)
catenary = Catenary(PointA=point_3, PointB=point, Length=addition_2, Gravity=unit_z)
catenary_2 = Catenary(PointA=point_3, PointB=point_2, Length=addition, Gravity=unit_z_2)
divide_curve = DivideCurve(Curve=catenary_2, Count=10, Kinks=False)  # -> Points, Tangents, Parameters
vector_2pt = Vector2Pt(PointA=point_3, PointB=divide_curve.Points, Unitize=False)  # -> Vector, Length
move = Move(Geometry=catenary, Motion=vector_2pt.Vector)  # -> Geometry, Transform
loft = Loft(Curves=move.Geometry, Options={Adjust=True, Closed=False, LoftEnds=0, LoftSimp=1, LoftType=0, Rebuild=10, Refit=0.01})

# ---- group: input boundary curve
point_on_1st_crv = Panel("0.405")
point_on_2nd_curve = Panel("0.881")
curve = Curve(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)

curve_2 = Curve(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)

# ----
boundary_surfaces = BoundarySurfaces(Edges=curve)
number_slider_2 = Slider(7.7, range=0..10)
mesh_brep = MeshBrep(
    Brep=boundary_surfaces,
    Settings={GridMaxCount=0, GridMinCount=16, JaggedSeams=False, MaxEdgeLength=0, MinEdgeLength=0.0001, MinTolerance=0, Refine=True, RefineAngle=0, RelativeTolerance=0.65, SimplePlanes=True, Tolerance=0})
triremesh = TriRemesh(Geometry=mesh_brep, Length=Slider(12, range=0..100), Iterations=25)  # -> Triangulation, Dual, Creases
number_slider_3 = Slider(0.39, range=0..1)

# ---- group: ADJUST & SPLIT INPUT CURVES
number_slider_4 = Slider(0.6, range=0.6..1.6)
seam = Seam(Curve=reparameterize(curve), Seam=number_slider_4)
divide_curve_2 = DivideCurve(Curve=seam, Count=Slider(66, range=3..100), Kinks=False)  # -> Points, Tangents, Parameters
nurbs_curve = NurbsCurve(Vertices=divide_curve_2.Points, Degree=2, Periodic=True)  # -> Curve, Length, Domain
shatter = Shatter(Curve=reparameterize(nurbs_curve.Curve), Parameters=[number_slider_3, Slider(0.916, range=0..1)])
rebuild_curve = RebuildCurve(Curve=shatter, Count=Slider(56, range=0..100), Tangents=False)
control_points = ControlPoints(Curve=rebuild_curve)  # -> Points, Weights, Knots

# ----
addition_3 = Addition(A=number_slider_3, B=number_slider_4)
deconstruct_mesh = DeconstructMesh(Mesh=triremesh.Triangulation)  # -> Vertices, Faces, Colours, Normals
nakedvertices = NakedVertices(Mesh=triremesh.Triangulation)  # -> ClothedIndex, NakedIndex, ClothedPts, NakedPts
number_slider_5 = Slider(10, range=0..100)
unit_z_3 = UnitZ(Factor=Slider(2, range=0..10))
edgelengths = EdgeLengths(Mesh=triremesh.Triangulation, LengthFactor=Slider(1.1, range=0..10), Strength=1)
load = Load(Point=deconstruct_mesh.Vertices, ForceVector=unit_z_3, Weighting=1)
anchor = Anchor(Point=nakedvertices.NakedPts, Strength=10000)
show = Show(G=triremesh.Triangulation)
mesh_brep_2 = MeshBrep(
    Brep=loft,
    Settings={GridMaxCount=0, GridMinCount=16, JaggedSeams=False, MaxEdgeLength=0, MinEdgeLength=0.0001, MinTolerance=0, Refine=True, RefineAngle=0, RelativeTolerance=0.65, SimplePlanes=True, Tolerance=0})
brep_edges = BrepEdges(Brep=loft)  # -> Naked, Interior, NonManifold
merge = Merge(Data1=show, Data2=load, Data3=anchor, Data4=edgelengths)
bouncysolver = BouncySolver(GoalObjects=merge, Reset=Button(), Threshold=1e-15, Tolerance=0.0001, Damping=0.99, Iterations=10, On=Toggle(False))  # -> I, V, O
list_item = ListItem(List=bouncysolver.O, Index=0, Wrap=True)

# ---- group: CULL END ARCS FOR ENTRANCES
number_slider_6 = Slider(4, range=0..10)
number_slider_7 = Slider(-2, range=-5..0)
construct_domain = ConstructDomain(DomainStart=number_slider_7, DomainEnd=number_slider_6)
subtraction = Subtraction(A=number_slider_6, B=number_slider_7)
range = Range(Domain=construct_domain, Steps=subtraction)
series = Series(Start=number_slider_7, Step=1, Count=number_slider_6)
panel = Panel(range)
cull_index = CullIndex(List=control_points.Points, Indices=panel, Wrap=True)

# ----
hexagon_cells = HexagonCells(Surface=loft, UDivisions=number_slider_5, VDivisions=number_slider_5, TParameter=0.25)  # -> HexagonCells, graft(Centers)
number_slider_8 = Slider(0.8, range=0..1)
triremesh_2 = TriRemesh(Geometry=mesh_brep_2, Length=Slider(5, range=0..10), Iterations=25)  # -> Triangulation, Dual, Creases
face_boundaries = FaceBoundaries(Mesh=graft(triremesh_2.Dual))
discontinuity = Discontinuity(Curve=hexagon_cells.HexagonCells, Level=1)  # -> Points, Parameters

# ---- group: zOffset
project = Project(Geometry=discontinuity.Points, Plane=PlaneXY(0, 0, 0))  # -> Geometry, Transform
vector_2pt_2 = Vector2Pt(PointA=discontinuity.Points, PointB=project.Geometry, Unitize=False)  # -> Vector, Length
bounds = Bounds(Numbers=flatten(vector_2pt_2.Length))
multiplication = Multiplication(A=vector_2pt_2.Vector, B=Slider(1, range=0..1))
gradient = Gradient(
    LowerLimit=0,
    UpperLimit=bounds,
    Parameter=multiplication,
    stops=[0: RGB(0, 128, 0), 0.5: RGB(255, 255, 0), 1: RGB(255, 0, 0)])
vector_display_ex = VectorDisplayEx(Point=discontinuity.Points, Vector=multiplication, Colour=gradient, Width=Slider(2.2, range=0..10))
move_2 = Move(Geometry=discontinuity.Points, Motion=multiplication)  # -> Geometry, Transform
delaunay_mesh = DelaunayMesh(Points=move_2.Geometry, Plane=PlaneXY(0, 0, 0))
polyline = PolyLine(Vertices=move_2.Geometry, Closed=False)
mesh_join = MeshJoin(Meshes=delaunay_mesh)
weld_mesh = WeldMesh(Mesh=mesh_join, Angle=3.141592654)
custom_preview_lineweights = CustomPreviewLineweights(
    Geometry=polyline,
    Shader=ColourSwatch(SwatchColor=RGB(255, 255, 255)),
    Thickness=Slider(2.1, range=0..10),
    Absolute=False)
mesh_curvature = MeshCurvature(Mesh=flatten(weld_mesh), CurvatureType=2, Radius=2, Method=1, Interval=Domain(0, 0), On=True)  # -> Mesh, flatten(CurvatureValues)
bounds_2 = Bounds(Numbers=mesh_curvature.CurvatureValues)
deconstruct_mesh_2 = DeconstructMesh(Mesh=weld_mesh)  # -> Vertices, Faces, Colours, Normals
deconstruct_domain = DeconstructDomain(Domain=bounds_2)  # -> Start, End
gradient_2 = Gradient(
    LowerLimit=deconstruct_domain.Start,
    UpperLimit=deconstruct_domain.End,
    Parameter=mesh_curvature.CurvatureValues,
    stops=[0: RGB(0, 255, 255), 0: RGB(0, 255, 255), 1: RGB(255, 0, 255)])
construct_mesh = ConstructMesh(Vertices=deconstruct_mesh_2.Vertices, Faces=deconstruct_mesh_2.Faces, Colours=gradient_2)

# ----
nakedvertices_2 = NakedVertices(Mesh=triremesh_2.Dual)  # -> ClothedIndex, NakedIndex, ClothedPts, NakedPts
unit_z_4 = UnitZ(Factor=1)
point_list = PointList(Points=cull_index, Size=Slider(2.2, range=0..10))

# ---- group: ARCS FOR LOFT
explode_tree = ExplodeTree(Data=cull_index)  # -> _00000, _00010
unit_z_5 = UnitZ(Factor=1)
arc_sed = ArcSED(Start=explode_tree._00000, End=reverse(explode_tree._00010), Direction=unit_z_5)  # -> Arc, Plane, Radius

# ----
distance_3 = Distance(PointA=explode_tree._00000, PointB=reverse(explode_tree._00010))

# ---- group: ENTRANCE GLAZING
list_item_2 = ListItem(List=arc_sed.Arc, Index=0, Wrap=True)  # -> Item1, Item, Item1_2
merge_2 = Merge(Data1=list_item_2.Item1, Data2=list_item_2.Item)
end_points = EndPoints(Curve=merge_2)  # -> Start, End
unit_z_6 = UnitZ(Factor=1)
line = Line(StartPoint=end_points.Start, EndPoint=end_points.End)
divide_curve_3 = DivideCurve(Curve=merge_2, Count=Slider(6, range=0..10), Kinks=False)  # -> Points, Tangents, Parameters
reverse = Reverse(Vector=unit_z_6)
join_curves = JoinCurves(Curves=[merge_2, line], Preserve=False)
project_point = ProjectPoint(Point=divide_curve_3.Points, Direction=reverse, Geometry=line)  # -> Point, Index
boundary_surfaces_2 = BoundarySurfaces(Edges=join_curves)
create_material = CreateMaterial(
    Diffuse=ColourSwatch(SwatchColor=RGB(120, 235, 255)),
    Specular=ColourSwatch(SwatchColor=RGB(178, 255, 255)),
    Emission=RGB(0, 0, 0),
    Transparency=Slider(0.48, range=0..1),
    Shine=Slider(100, range=0..100))
line_2 = Line(StartPoint=project_point.Point, EndPoint=divide_curve_3.Points)
custom_preview = CustomPreview(Geometry=boundary_surfaces_2, Material=create_material)

# ----
addition_4 = Addition(A=distance_3, B=Slider(10, range=0..10))
catenary_3 = Catenary(PointA=explode_tree._00000, PointB=reverse(explode_tree._00010), Length=addition_4, Gravity=unit_z_4)
explode = Explode(Curve=hexagon_cells.HexagonCells, Recursive=True)  # -> Segments, Vertices
average = Average()
removeduplicatelines = RemoveDuplicateLines(Lines=explode.Segments, Tolerance=0.01)
end_points_2 = EndPoints(Curve=removeduplicatelines)  # -> Start, End

# ---- group: TARGET FORM
loft_options = LoftOptions(Closed=False, Adjust=False, Rebuild=0, Refit=1, Type=0)
loft_2 = Loft(Curves=arc_sed.Arc, Options=loft_options)

# ----
vector_2pt_3 = Vector2Pt(PointA=end_points_2.Start, PointB=end_points_2.End, Unitize=False)  # -> Vector, Length
deconstruct_vector = DeconstructVector(Vector=vector_2pt_3.Vector)  # -> XComponent, YComponent, ZComponent
merge_3 = Merge(Data1=discontinuity.Points, Data2=hexagon_cells.Centers)
triremesh_3 = TriRemesh(Geometry=loft_2, Iterations=25)  # -> Triangulation, Dual, Creases
unit_y = UnitY(Factor=1)
vector_xyz = VectorXYZ(XComponent=deconstruct_vector.XComponent, YComponent=deconstruct_vector.YComponent, ZComponent=0)  # -> Vector, Length
xy_plane = XYPlane(Origin=Point(0, 0, 0))
list_item_3 = ListItem(List=removeduplicatelines, Index=Slider(3, range=0..10), Wrap=True)  # -> Item, Item1, Item2, Item3, Item4, Item5
pull_point = PullPoint(Point=flatten(merge_3), Geometry=brep_edges.Naked, ClosestOnly=True)  # -> ClosestPoint, Distance
angle = Angle(VectorA=vector_xyz.Vector, VectorB=unit_y, Plane=xy_plane)  # -> Angle, Reflex
imagecircles = ImageCircles(Min=0.2, Max=1, Strength=1)
smaller_than = SmallerThan(FirstNumber=angle.Angle, SecondNumber=Slider(0.0197, range=0..0.1))  # -> SmallerThan, OrEqualTo
smaller_than_2 = SmallerThan(FirstNumber=pull_point.Distance, SecondNumber=0.01)  # -> SmallerThan, OrEqualTo
dispatch = Dispatch(List=removeduplicatelines, DispatchPattern=smaller_than.SmallerThan)  # -> ListA, ListB

# ---- group: VISUALIZATION
curve_3 = Curve(curve)
merge_4 = Merge(Data1=line_2, Data2=curve_3, Data3=line)
colour_swatch = ColourSwatch(SwatchColor=RGB(0, 0, 0))
custom_preview_lineweights_2 = CustomPreviewLineweights(Geometry=merge_4, Shader=colour_swatch, Absolute=False)
create_material_2 = CreateMaterial(
    Diffuse=ColourSwatch(SwatchColor=RGB(255, 215, 140)),
    Specular=ColourSwatch(SwatchColor=RGB(222, 191, 191)),
    Emission=RGB(0, 0, 0),
    Transparency=Slider(0, range=0..1),
    Shine=Slider(87.1, range=0..100))
custom_preview_2 = CustomPreview(Material=create_material_2)
group_toggle = GroupToggle(ToggleActive=True, ToggleVisible=False)  # disabled

# ----
cull_pattern = CullPattern(List=flatten(merge_3), CullPattern=smaller_than_2.SmallerThan)
curve_4 = Curve(dispatch.ListB)
model_linetype = ModelLinetype(Name=<missing>, Width=<missing>)  # -> ModelLinetype, Name, Segments, CapStyle, JoinStyle, Width, WidthUnits
show_2 = Show(G=hexagon_cells.HexagonCells)
equalangle = EqualAngle(
    LineA=[list_item_3.Item1, list_item_3.Item4],
    LineB=[list_item_3.Item2, list_item_3.Item5],
    Strength=Slider(5000, range=0..100000))
curve_5 = Curve(dispatch.ListA)
length = Length(Curve=curve_5)
length_2 = Length(Curve=curve_4)
point_4 = Point(cull_pattern)
multiplication_2 = Multiplication(A=length, B=Slider(2.99, range=0..10))
multiplication_3 = Multiplication(A=length_2, B=Slider(1, range=0..1))
onmesh = OnMesh(Points=flatten(merge_3), Mesh=mesh_brep_2, Strength=Slider(2550, range=0..100000))
coplanar = CoPlanar(Points=merge_3, Strength=Slider(10000, range=0..10000))
multiplication_4 = Multiplication(A=length, B=Slider(1.7, range=0..10))
custom_curve_preview = CustomCurvePreview(Curve=[<missing>, curve_3, line_2, line], Linetype=model_linetype.ModelLinetype, Colour=colour_swatch)
multiplication_5 = Multiplication(A=length_2, B=Slider(0.3, range=0..1))
number_slider_9 = Slider(10000, range=0..10000)
anchor_2 = Anchor(Point=flatten(point_4), Strength=Slider(10000, range=0..10000))
clamplength = ClampLength(Line=curve_5, LowerLimit=multiplication_4, UpperLimit=multiplication_2, Strength=Slider(10000, range=0..10000))
clamplength_2 = ClampLength(Line=curve_4, LowerLimit=multiplication_5, UpperLimit=multiplication_3, Strength=number_slider_9)
equallength = EqualLength(Line=curve_5, Strength=Slider(10000, range=0..10000))
equallength_2 = EqualLength(Line=curve_4, Strength=number_slider_9)
merge_5 = Merge(
    Data1=show_2,
    Data2=coplanar,
    Data3=clamplength,
    Data4=anchor_2,
    Data5=onmesh,
    Data6=clamplength_2,
    Data7=equallength,
    Data8=equallength_2,
    Data9=equalangle)
bouncysolver_2 = BouncySolver(
    GoalObjects=flatten(merge_5),
    Reset=Button(),
    Threshold=1e-15,
    Tolerance=0.0001,
    Damping=0.99,
    Iterations=10,
    On=Toggle(False))  # -> I, V, O
number_slider_10 = Slider(10, range=0..10)
clean_tree = CleanTree(RemoveNulls=True, RemoveInvalid=True, RemoveEmpty=False, Tree=bouncysolver_2.O)
list_item_4 = ListItem(List=bouncysolver_2.O, Index=0, Wrap=True)
curve_6 = Curve(clean_tree)
discontinuity_2 = Discontinuity(Curve=curve_6, Level=1)  # -> Points, Parameters
delaunay_mesh_2 = DelaunayMesh(Points=discontinuity_2.Points, Plane=PlaneXY(0, 0, 0))  # -> flatten(Mesh)
mesh_join_2 = MeshJoin(Meshes=delaunay_mesh_2)
mesh_edges = MeshEdges(Mesh=delaunay_mesh_2)  # -> NakedEdges, InteriorEdges, NonManifoldEdges
weld_mesh_2 = WeldMesh(Mesh=mesh_join_2, Angle=3.141592654)
mesh_curvature_2 = MeshCurvature(Mesh=weld_mesh_2, CurvatureType=3, Radius=2, Method=1, Interval=Domain(0, 0), On=True)  # -> Mesh, CurvatureValues
bounds_3 = Bounds(Numbers=mesh_curvature_2.CurvatureValues)
curve_7 = Curve(curve_6)
deconstruct_domain_2 = DeconstructDomain(Domain=bounds_3)  # -> Start, End
deconstruct_mesh_3 = DeconstructMesh(Mesh=weld_mesh_2)  # -> Vertices, Faces, Colours, Normals
gradient_3 = Gradient(
    LowerLimit=deconstruct_domain_2.Start,
    UpperLimit=deconstruct_domain_2.End,
    Parameter=mesh_curvature_2.CurvatureValues,
    stops=[0: RGB(0, 255, 255), 0: RGB(0, 255, 255), 1: RGB(255, 0, 255)])
construct_mesh_2 = ConstructMesh(Vertices=deconstruct_mesh_3.Vertices, Faces=deconstruct_mesh_3.Faces, Colours=gradient_3)
custom_preview_lineweights_3 = CustomPreviewLineweights(Geometry=curve_7, Shader=ColourSwatch(SwatchColor=RGB(255, 255, 255)), Absolute=False)
