# Grasshopper definition WillNash_seaweed.gh (Grasshopper 1.0.7)
# plug-ins: Kangaroo2 Components, Weaverbird, ShapeDiverForGrasshopper

perbutation = GetNumber(
    Slider(0.3, range=0..1),
    AtLeast=1,
    AtMost=1,
    Maximum=1.797693135e+308,
    Minimum=-1.797693135e+308,
    Prompt="initial perbutation [0.0 ... 1.0]",
    TreeAccess=False)
sddp = ShapeDiverDocumentPayload({AbsoluteTolerance=0, AngleTolerance=0, DistanceDisplayPrecision=0, GltfVersion="Gltf2", GrasshopperVersion="1.0.0007", InputGroups="{}", OutputGroups="{}", RelativeTolerance=0, RhinoVersion="7.35.23346.11001", UnitSystem=0, VersionCreated="1.16.1.0", VersionSaved="1.16.1.0"})
get_integer = GetInteger(Slider(45, range=0..100), AtLeast=1, AtMost=1, Maximum=2147483647, Minimum=-2147483648, TreeAccess=False)
size = GetNumber(
    Slider(12, range=1..25),
    AtLeast=1,
    AtMost=1,
    Maximum=1.797693135e+308,
    Minimum=-1.797693135e+308,
    Prompt="size of initial circle [1.0...25.0]",
    TreeAccess=False)
negative = Negative(Value=perbutation)
R = Radius(size)
custom_mesh_settings = SettingsCustom(
    StitchSeams=True,
    SimplePlanes=False,
    Refine=True,
    MinCount=16,
    MaxCount=400,
    AspectRatio=20,
    MaxDistance=0,
    MaxAngle=20,
    MinEdge=0,
    MaxEdge=1)
construct_domain = ConstructDomain(DomainStart=negative, DomainEnd=perbutation)
cir = Circle(Plane=PlaneXY(0, 0, 0), Radius=R)
mesh = MeshBrep(Brep=cir, Settings=custom_mesh_settings)
demesh = DeconstructMesh(Mesh=mesh)  # -> Vertices, Faces, Colours, Normals
list_length = ListLength(List=demesh.Vertices)
random = Random(Range=construct_domain, Number=list_length, Seed=get_integer)
unit_z = UnitZ(Factor=random)
move = Move(Geometry=demesh.Vertices, Motion=unit_z)  # -> Geometry, Transform
vlen = VectorLength(Vector=move.Geometry)
bounds = Bounds(Numbers=vlen)
gradient = Gradient(LowerLimit=0, UpperLimit=bounds, Parameter=reverse(vlen), stops=[0: RGB(255, 255, 255), 1: RGB(0, 0, 0)])
average = Average(Input=[size, perbutation, get_integer])
conmesh = ConstructMesh(Vertices=move.Geometry, Faces=demesh.Faces, Colours=gradient)
data_dam = DataDam(DataDataA=average, BufferDelay=5000000, BufferMode=2)
nakedvertices = NakedVertices(Mesh=conmesh)  # -> ClothedIndex, NakedIndex, ClothedPts, NakedPts
average_2 = Average(Input=nakedvertices.NakedPts)
button = Button()
iter = Iterations(Slider(3, range=0..10))
equality = Equality(FirstNumber=average, SecondNumber=data_dam)  # -> Equality, Inequality
data_dam_2 = DataDam(DataDataA=average_2, BufferDelay=10000000, BufferMode=2)
remeshbycolour = RemeshByColour(
    Mesh=conmesh,
    LengthInterval=Domain(0.3, 2),
    FixVertices=nakedvertices.NakedPts,
    Flip=1,
    Iterations=iter,
    Reset=equality.Inequality)
equality_2 = Equality(FirstNumber=average_2, SecondNumber=data_dam_2)  # -> Equality, Inequality
medges = MeshEdges(Mesh=remeshbycolour)  # -> NakedEdges, InteriorEdges, NonManifoldEdges
demesh_2 = DeconstructMesh(Mesh=remeshbycolour)  # -> Vertices, Faces, Colours, Normals
show = Show(G=remeshbycolour)
join = JoinCurves(Curves=medges.NakedEdges, Preserve=False)
length_line = LengthLine(Line=[medges.NakedEdges, medges.InteriorEdges], Strength=0.2)
smooth = Smooth(M=remeshbycolour, Strength=25)
explode = Explode(Curve=join, Recursive=True)  # -> Segments, Vertices
sc = SphereCollide(Points=demesh_2.Vertices, Radius=3, Strength=1)
grab = Grab(On=True, Strength=1, Range=3)
shift = ShiftList(List=explode.Segments, Shift=1, Wrap=True)
button_2 = Button()
angle = Angle(LineA=explode.Segments, LineB=shift, RestAngle=0, Strength=10)
entwine = Entwine(Branch00=show, Branch01=[length_line, sc, smooth, angle, grab], FlattenInputs=True)
solver = Solver(GoalObjects=entwine, Reset=equality_2.Inequality, Threshold="1e-6", Tolerance=0.01, On=Toggle(True))  # -> I, V, flatten(O)
item = ListItem(List=solver.O, Index=0, Wrap=True)
bang = ExplodeTree(Data=solver.O)  # -> Branch0, Branch1
wbloop = WeaverbirdsLoopSubdivision(MeshCurves=bang.Branch0, Level=2, SmoothNakedEdges=1)
context_bake = ContextBake(SeaweedMesh=wbloop)
