# Grasshopper definition check.gh (Grasshopper 1.0.7)
# plug-ins: Hops, ShapeDiverForGrasshopper

sddp = ShapeDiverDocumentPayload({AbsoluteTolerance=0, AngleTolerance=0, DistanceDisplayPrecision=0, GltfVersion="Gltf2", GrasshopperVersion="1.0.0007", InputGroups="{}", OutputGroups="{}", RelativeTolerance=0, RhinoVersion="7.35.23346.11001", UnitSystem=0, VersionCreated="1.16.1.0", VersionSaved="1.16.1.0"})
hops = Hops(
    Reset=Button(),
    Grow=Toggle(True),
    Select=Slider(0, range=0..2),
    MaxVertices=Slider(180, range=0..1000),
    Resolution=Slider(3.8, range=0..10),
    Iterations=Slider(80, range=0..1000),
    CacheResultsInMemory=False,
    CacheSolveResults=True,
    RemoteDefinitionLocation="C:\Users\cawn069856\gits\datamgmt\bimsc24-datamgmt-session01\Session01\WillNash\hops_WillNash.gh",
    RemoteSolveVersion=(0, 1, 0),
    ShowInput_Enabled=False,
    ShowInput_Path=False,
    SynchronousSolve=False)
mesh = Mesh(hops)
custom_preview = CustomPreview(Geometry=mesh, Material=ColourSwatch(SwatchColor=RGB(166, 255, 227)))
