# Grasshopper definition hops_WillNash_circlepacking.gh (Grasshopper 1.0.7)
# plug-ins: Pufferfish

surface = Surface(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)
surface_2 = Surface(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)
surface_3 = Surface(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)
merge = Merge(Data1=surface, Data2=surface_2, Data3=surface_3)
select = GetInteger(
    Slider(2, range=0..2),
    AtLeast=1,
    AtMost=1,
    Maximum=2147483647,
    Minimum=-2147483648,
    Prompt="select a starting mesh: 0 = hyperbolic paraboloid, 1 = enneper surface, 2 = toroid",
    TreeAccess=False)
reset = GetBoolean(Button(), AtLeast=1, AtMost=1, FalseValue="False", Prompt="button to reset", TreeAccess=False, TrueValue="True")
iterations = GetInteger(Slider(275, range=0..300), AtLeast=1, AtMost=1, Maximum=2147483647, Minimum=-2147483648, TreeAccess=False)
visselect = GetBoolean(
    Toggle(False),
    AtLeast=1,
    AtMost=1,
    FalseValue="False",
    Prompt="set false to colour by position or true to colour by vector",
    TreeAccess=False,
    TrueValue="True")
octree = OcTree(Square=False, Group=5)  # -> Boxes, Points
max_circles = GetInteger(
    Slider(297, range=10..1000),
    AtLeast=1,
    AtMost=1,
    Maximum=2147483647,
    Minimum=-2147483648,
    Prompt="Set the max. vertices [int: 10 : 1000]",
    TreeAccess=False)
radius = GetNumber(
    Slider(2.1, range=0.5..10),
    AtLeast=1,
    AtMost=1,
    Maximum=1.797693135e+308,
    Minimum=-1.797693135e+308,
    Prompt="Set the resolution [double: 0.5 : 10.0]",
    TreeAccess=False)
list_item = ListItem(List=merge, Index=select, Wrap=True)
surface_4 = Surface(reparameterize(list_item))
c_script = CSharpScript(srf=surface_4, maxCircles=max_circles, radius=radius, reset=reset, iterations=iterations, pull2surf=Toggle(True))  # -> out, centerPts, directions; inputs srf: Surface, maxCircles: Int32, radius: Double, reset: Boolean, iterations: Int32, pull2surf: Boolean
# ---------- c_script: C# ----------
    if (reset)
    {
      centers = new List<Point3d>();

      Point3d initPt = srf.PointAt(0.5, 0.5);
      Vector3d initNorm = srf.NormalAt(0.5, 0.5);
      Plane circPlane = new Plane(initPt, initNorm);
      Circle initCircle = new Circle(circPlane, radius);
      NurbsCurve circleCurve = initCircle.ToNurbsCurve();

      double [] newPts = circleCurve.DivideByCount(3, true);

      foreach (double t in newPts)
      {
        centers.Add(PullToSrf(circleCurve.PointAt(t), srf));
      }
    }

    for (int i = 0; i < iterations; i++)
    {
      totalMoves = new List<Vector3d>();
      List<int> collisionCount = new List<int>();
      //      normals = new List<Vector3d>();
      //      planes = new List<Plane>();

      for (int j = 0; j < centers.Count; j++)
      {
        totalMoves.Add(Vector3d.Zero);
        collisionCount.Add(0);
        if (pull2surf) centers[j] = PullToSrf(centers[j], srf);
      }

      RTree rTree = new RTree();

      for (int j = 0; j < centers.Count; j++)
      {
        rTree.Insert(centers[j], j);
      }
      for (int j = 0; j < centers.Count; j++)
      {
        Sphere searchSphere = new Sphere(centers[j], radius);
        List<int> collisionIndices = new List<int>();

        rTree.Search(
          searchSphere,
          (sender, args) => { if (j < args.Id) collisionIndices.Add(args.Id); });

        foreach (int k in collisionIndices)
        {
          Vector3d move = centers[k] - centers[j];
          double currentDistance = move.Length;
          move *= 0.5 * (currentDistance - radius) / currentDistance;
          totalMoves[j] += move;
          totalMoves[k] -= move;
          collisionCount[j] += 1;
          collisionCount[k] += 1;
        }
      }
      for (int j = 0; j < centers.Count; j++)
      {
        if (collisionCount[j] == 0) continue;
        centers[j] += totalMoves[j] / collisionCount[j];
      }

      if (centers.Count < maxCircles)
      {
        List<int> splitIndices = new List<int>();

        for (int j = 0; j < centers.Count - 1; j++)
          if (centers[j].DistanceTo(centers[j + 1]) > radius * 0.99)
            splitIndices.Add(j + 1 + splitIndices.Count);

        foreach (int splitIndex in splitIndices)
        {
          Point3d newCenter = 0.5 * (centers[splitIndex - 1] + centers[splitIndex]);
          centers.Insert(splitIndex, newCenter);
        }
      }


    }

    directions = totalMoves;
    centerPts = centers;
# ---------- c_script: C# additional code ----------
  List<Point3d> centers;
  List<Vector3d> totalMoves;
  //  List<int> collisionCount;
  //  List<Vector3d> normals;
  //  List<Plane> planes;

  public Point3d PullToSrf(Point3d pt, Surface srf)
  {
    double ptU = new double();
    double ptV = new double();
    srf.ClosestPoint(pt, out ptU, out ptV);
    return srf.PointAt(ptU, ptV);
  }
# ---------- end c_script ----------
deconstruct_vector = DeconstructVector(Vector=c_script.directions)  # -> XComponent, YComponent, ZComponent
point = Point(c_script.centerPts)
deconstruct = Deconstruct(Point=point)  # -> XComponent, YComponent, ZComponent
surface_closest_point = SurfaceClosestPoint(Point=point, Surface=surface_4)  # -> Point, UVPoint, Distance
addition = Addition(A=deconstruct_vector.XComponent, B=deconstruct_vector.YComponent)
addition_2 = Addition(A=deconstruct.XComponent, B=deconstruct.YComponent)
addition_3 = Addition(A=addition, B=deconstruct_vector.ZComponent)
addition_4 = Addition(A=addition_2, B=deconstruct.ZComponent)
evaluate_surface = EvaluateSurface(Surface=surface_4, Point=surface_closest_point.UVPoint)  # -> Point, Normal, UDirection, VDirection, Frame
c_script_2 = CSharpScript(iSurface=surface_4, iCenters=point, iDistance=radius)  # -> out, polyPoints; inputs iSurface: Surface, iCenters: list of Point3d, iDistance: Double; disabled
# ---------- c_script_2: C# ----------
    List<Point3d> centers = new List<Point3d>(iCenters);

    /* create rTree for searching points within distance */
    RTree plateCenters = new RTree();
    for (int i = 0; i < centers.Count; i++)
    {
      plateCenters.Insert(centers[i], i);
    }

    //    DataTree<Point3d> pPts = new DataTree<Point3d>();

    // for (int i = 0; i<centers.Count; i++)
    // {
    //     Sphere searchSphere0 = new Sphere(centers[i], iDistance);
    //     List<Point3d> collisionPts = new List<Point3d>();
    //     plateCenters.Search(
    //         searchSphere0,
    //         (sender, args) => {if (i < args.Id) collisionPts.Add(centers[args.Id]); });

    //     List<Point3d> platePoints = new List<Point3d>();
    //     Point3d[] sortedPts = Point3d.SortAndCullPointList(collisionPts, iDistance*0.1);

    //     if (sortedPts is null)
    //         continue;
    //     else
    //         platePoints.AddRange(sortedPts);

    //     List<Point3d> branchPoints = new List<Point3d>();
    //     for (int j = 0 ; j<platePoints.Count; j++)
    //     {
    //         if (j+1<platePoints.Count)
    //         {
    //             Point3d outPoint = (centers[i] + platePoints[j] + platePoints[j+1])/3.0;
    //             branchPoints.Add(outPoint);
    //         }
    //         else
    //         {
    //             Point3d outPoint = (centers[i] + platePoints[j] + platePoints[0])/3.0;
    //             branchPoints.Add(outPoint);
    //         }

    //     }
    //     GH_Path path = new GH_Path(i);
    //     pPts.AddRange(branchPoints, path);
    // }


    List<Point3d> intersectionPoints = new List<Point3d>();
    /*iterate over centers and generate nearest circles, and collect intersection points */
    for (int i = 0; i < centers.Count; i++)
    {
      Sphere searchSphere0 = new Sphere(centers[i], iDistance);
      List<int> collisionIndices = new List<int>();
      List<Circle> compasses = new List<Circle>();
      plateCenters.Search(
        searchSphere0,
        (sender, args) => {if (i < args.Id) collisionIndices.Add(args.Id); });
      foreach (int j in collisionIndices)
      {
        double uU;
        double vV;
        iSurface.ClosestPoint(centers[j], out uU, out vV);
        Vector3d normL = iSurface.NormalAt(uU, vV);
        Plane plane = new Plane(centers[j], normL);
        compasses.Add(new Circle(plane, iDistance * 0.5));
      }
      double testU;
      double testV;
      iSurface.ClosestPoint(centers[i], out testU, out testV);
      Vector3d testNormL = iSurface.NormalAt(testU, testV);
      Plane testPlane = new Plane(centers[i], testNormL);
      Circle testCirc = new Circle(testPlane, iDistance * 0.5);
      foreach (Circle compass in compasses)
      {

        Rhino.Geometry.Intersect.CurveIntersections intersectResult = Rhino.Geometry.Intersect.Intersection.CurveCurve(testCirc.ToNurbsCurve(), compass.ToNurbsCurve(), iDistance * 0.2, iDistance * 0.2);

        for (int j = 0; j < intersectResult.Count; j++)
        {
          intersectionPoints.Add(intersectResult[j].PointA);
          intersectionPoints.Add(intersectResult[j].PointA2);
        }
      }
      polyPoints = intersectionPoints;
    }
    // /* create an RTree for searching the intersectionPoints*/
    // RTree intersectionPointsRTree = new RTree();
    // for (int i = 0; i<intersectionPoints.Count; i++)
    // {
    //     intersectionPointsRTree.Insert(intersectionPoints[i], i);
    // }

    // /* iterate over the intersectionPoints and take the average of close points*/
    // List<Point3d> averagedIntersectionPoints = new List<Point3d>();
    // for (int i=0; i<centers.Count; i++)
    // {
    //     List<Point3d> subSearch = new List<Point3d>();
    //     Sphere searchSphere1 = new Sphere(centers[i], iDistance/1.5);
    //     intersectionPointsRTree.Search(
    //         searchSphere1,
    //         (sender, args) =>  {if (i < args.Id) subSearch.Add(intersectionPoints[args.Id]); } );

    //     for(int j=0; j<subSearch.Count;j++)
    //     {
    //         List<Point3d> pointsToAverage = new List<Point3d>();
    //         Sphere searchSphere2 = new Sphere(subSearch[j], iDistance*0.2);
    //         intersectionPointsRTree.Search(
    //             searchSphere2,
    //             (sender, args) =>  {if (i < args.Id) pointsToAverage.Add(intersectionPoints[args.Id]); } );
    //         Point3d averagedPt = AveragePtList(pointsToAverage);
    //         averagedIntersectionPoints.Add(averagedPt);
    //     }

    // }
    // /* create RTree for averagedIntersectionPoints*/
    // RTree avgIntPts = new RTree();
    // for (int i = 0; i<averagedIntersectionPoints.Count; i++)
    // {
    //     avgIntPts.Insert(averagedIntersectionPoints[i], i);
    // }

    // /* create DataTree for the sorted points of each center point */
    // // DataTree<Point3d> pPts = new DataTree<Point3d>();
    // IEnumerable<int[]> closestPts = RTree.Point3dClosestPoints(centers, averagedIntersectionPoints, iDistance/1.2);

    // int pathNo = 0;

    // foreach (int[] pointIndices in closestPts)
    // {
    //     GH_Path path = new GH_Path(pathNo);
    //     if (pointIndices.Length==0)
    //         continue;
    //     List<Point3d> branchList = new List<Point3d>();
    //     for (int i=0; i<pointIndices.Length; i++)
    //     {
    //         branchList.Add(averagedIntersectionPoints[pointIndices[i]]);
    //     }

    //     pPts.AddRange(Point3d.SortAndCullPointList(branchList, iDistance*0.1), path);
    //     pathNo+=1;
    // }

    // for (int i = 0; i<centers.Count; i++)
    // {

    // }


    polyPoints = intersectionPoints;
# ---------- end c_script_2 ----------
reparameterize_numbers = ReparameterizeNumbers(Numbers=addition_3, Invert=False)  # -> Reparameterized, Original
reparameterize_numbers_2 = ReparameterizeNumbers(Numbers=addition_4, Invert=False)  # -> Reparameterized, Original
division = Division(A=radius, B=2)
mesh_sphere = MeshSphere(Base=point, Radius=division, UCount=10, VCount=20)
stream_filter = StreamFilter(Gate=visselect, Stream0=reparameterize_numbers_2.Reparameterized, Stream1=reparameterize_numbers.Reparameterized)
deconstruct_mesh = DeconstructMesh(Mesh=mesh_sphere)  # -> Vertices, Faces, Colours, Normals
gradient = Gradient(
    LowerLimit=0,
    UpperLimit=1,
    Parameter=stream_filter,
    stops=[0: RGB(243, 57, 0), 0.1: RGB(236, 27, 60), 0.2: RGB(210, 0, 118), 0.3: RGB(103, 0, 120), 0.4: RGB(39, 72, 161), 0.5: RGB(1, 192, 229), 0.6: RGB(18, 178, 90), 0.7: RGB(79, 186, 8), 0.8: RGB(220, 237, 32), 0.9: RGB(247, 159, 20), 1: RGB(243, 57, 0)])
construct_mesh = ConstructMesh(Vertices=deconstruct_mesh.Vertices, Faces=deconstruct_mesh.Faces, Colours=graft(gradient))
context_bake = ContextBake(MeshBalls=construct_mesh)
