# Grasshopper definition assignment 01.gh (Grasshopper 1.0.7)
# plug-ins: Pufferfish

width = GetInteger(Slider(18, range=1..50), AtLeast=1, AtMost=1, Maximum=2147483647, Minimum=-2147483648, TreeAccess=False)
height = GetInteger(Slider(11, range=1..50), AtLeast=1, AtMost=1, Maximum=2147483647, Minimum=-2147483648, TreeAccess=False)
xz_plane = XZPlane(Origin=Point(0, 0, 0))
number_of_transoms = GetInteger(Slider(5, range=1..20), AtLeast=1, AtMost=1, Maximum=2147483647, Minimum=-2147483648, TreeAccess=False)
number_of_mullions = GetInteger(Slider(5, range=1..20), AtLeast=1, AtMost=1, Maximum=2147483647, Minimum=-2147483648, TreeAccess=False)
rectangle = Rectangle(Plane=xz_plane, XSize=width, YSize=height, Radius=0)  # -> Rectangle, Length
explode = Explode(Curve=rectangle.Rectangle, Recursive=True)  # -> Segments, Vertices
list_item = ListItem(List=explode.Segments, Index=Slider(0, range=0..10), Wrap=True)
list_item_2 = ListItem(List=explode.Segments, Index=Slider(2, range=0..10), Wrap=True)
list_item_3 = ListItem(List=explode.Segments, Index=Slider(1, range=0..10), Wrap=True)
mullion_position = GetNumber(
    [Slider(0, range=0..1), Slider(0.15, range=0..1), Slider(0.36, range=0..1), Slider(0.67, range=0..1), Slider(1, range=0..1)],
    AtLeast=1,
    AtMost=1,
    Maximum=1.797693135e+308,
    Minimum=-1.797693135e+308,
    TreeAccess=False)
point = Point(Point(0, -0.4118796214, 0))
transom_position = GetNumber(
    [Slider(0.07, range=0..1), Slider(0.42, range=0..1), Slider(0.51, range=0..1), Slider(0.89, range=0..1), Slider(1, range=0..1)],
    AtLeast=1,
    AtMost=1,
    Maximum=1.797693135e+308,
    Minimum=-1.797693135e+308,
    TreeAccess=False)
profile_length = GetNumber(Slider(0.4, range=0..0.4), AtLeast=1, AtMost=1, Maximum=1.797693135e+308, Minimum=-1.797693135e+308, TreeAccess=False)
profile_width = GetNumber(Slider(0.24, range=0..0.4), AtLeast=1, AtMost=1, Maximum=1.797693135e+308, Minimum=-1.797693135e+308, TreeAccess=False)
evaluate_curve = EvaluateCurve(Curve=reparameterize(list_item), Parameter=mullion_position)  # -> Point, Tangent, Angle
negative = Negative(Value=Slider(0.43, range=0..10))
evaluate_curve_2 = EvaluateCurve(Curve=reparameterize(list_item_3), Parameter=transom_position)  # -> Point, Tangent, Angle
unit_y = UnitY(Factor=negative)
rectangle_2 = Rectangle(Plane=point, XSize=profile_width, YSize=profile_length, Radius=0)  # -> Rectangle, Length
move = Move(Geometry=evaluate_curve_2.Point, Motion=unit_y)  # -> Geometry, Transform
point_2 = Point(Point(0, 0, 0))
yz_plane = YZPlane(Origin=evaluate_curve.Point)
horizontal_frame = HorizontalFrame(Curve=list_item, Parameter=evaluate_curve.Point)
xy_plane = XYPlane(Origin=point_2)
length = Length(Curve=list_item_3)
yz_plane_2 = YZPlane(Origin=move.Geometry)
project = Project(Geometry=graft(move.Geometry), Plane=yz_plane)  # -> Geometry, Transform
boundary_surfaces = BoundarySurfaces(Edges=rectangle_2.Rectangle)
rotate = Rotate(Geometry=yz_plane_2, Angle=degrees(Slider(90, range=0..100)), Plane=yz_plane_2)  # -> Geometry, Transform
boundary_surfaces_2 = BoundarySurfaces(Edges=rectangle_2.Rectangle)
orient = Orient(Geometry=graft(boundary_surfaces), Source=xy_plane, Target=rotate.Geometry)  # -> Geometry, Transform
orient_2 = Orient(Geometry=graft(boundary_surfaces_2), Source=xy_plane, Target=horizontal_frame)  # -> Geometry, Transform
length_2 = Length(Curve=list_item_2)
offset_mesh = OffsetMesh(Mesh=orient_2.Geometry, Distance=length, BothSides=0, CreateSolid=True)
unit_y_2 = UnitY(Factor=Slider(0.1, range=0..0.1))
offset_mesh_2 = OffsetMesh(Mesh=orient.Geometry, Distance=expr("x*-1", length_2), BothSides=0, CreateSolid=True)
boundary_surfaces_3 = BoundarySurfaces(Edges=rectangle.Rectangle)
bounding_box = BoundingBox(Content=offset_mesh, Plane=PlaneXY(0, 0, 0))  # -> flatten(Box), Box_2
negative_2 = Negative(Value=unit_y_2)
bounding_box_2 = BoundingBox(Content=offset_mesh_2, Plane=PlaneXY(0, 0, 0))  # -> flatten(Box), Box_2
move_2 = Move(Geometry=boundary_surfaces_3, Motion=negative_2)  # -> Geometry, Transform
solid_union = SolidUnion(Breps=[bounding_box.Box, bounding_box_2.Box])
context_bake = ContextBake(Geometry=solid_union)
brep_brep = BrepBrep(BrepA=move_2.Geometry, BrepB=solid_union)  # -> Curves, Points
boundary_surfaces_4 = BoundarySurfaces(Edges=brep_brep.Curves)
offset_mesh_3 = OffsetMesh(Mesh=boundary_surfaces_4, Distance=Slider(0.06, range=0..0.1), BothSides=0, CreateSolid=True)
panels = ContextBake(Geometry=flatten(offset_mesh_3))
