# Grasshopper definition hops_example.gh (Grasshopper 1.0.7)
# plug-ins: Hops

# raw version from Github URL: https://github.com/iaac-macad/bimsc24-datamgmt-session01/raw/Reinhardt01/Session01/Spikey.gh
link_to_local_file_path = Panel("C:\Users\rswart\OneDrive - SmithGroup Companies Inc\IAAC\BIMSC\Data Management\bimsc24-datamgmt-session01\bimsc24-datamgmt-session01\Session01\Spikey_hops.gh")
hops = Hops(
    _Path=link_to_local_file_path,
    Radius=Slider(9.72, range=0..10),
    Count=Slider(100, range=0..100),
    Length=Slider(9.14, range=0..10),
    CacheResultsInMemory=True,
    CacheSolveResults=True,
    RemoteDefinitionLocation="C:\Users\rswart\OneDrive - SmithGroup Companies Inc\IAAC\BIMSC\Data Management\bimsc24-datamgmt-session01\bimsc24-datamgmt-session01\Session01\Spikey_hops.gh",
    RemoteSolveVersion=(0, 1, 0),
    ShowInput_Enabled=False,
    ShowInput_Path=True,
    SynchronousSolve=True)
