# Grasshopper definition random_cube.gh (Grasshopper 1.0.7)

cell_size = Slider(3.235, range=0..10)
max_height = Slider(10, range=0..10)
x_rotation = Slider(46.88, range=0..100)
y_rotation = Slider(40, range=0..100)
cell_size_2 = GetNumber(cell_size, AtLeast=1, AtMost=1, Maximum=1.797693135e+308, Minimum=-1.797693135e+308, TreeAccess=False)
max_height_2 = GetNumber(max_height, AtLeast=1, AtMost=1, Maximum=1.797693135e+308, Minimum=-1.797693135e+308, TreeAccess=False)
x_rotation_2 = GetNumber(x_rotation, AtLeast=1, AtMost=1, Maximum=1.797693135e+308, Minimum=-1.797693135e+308, TreeAccess=False)
y_rotation_2 = GetNumber(y_rotation, AtLeast=1, AtMost=1, Maximum=1.797693135e+308, Minimum=-1.797693135e+308, TreeAccess=False)
number_slider = Slider(15, range=0..100)
point = Point(Point(0.05803024519, 0.05493314511, 0))
square = Square(Plane=point, Size=cell_size_2, ExtentX=number_slider, ExtentY=number_slider)  # -> flatten(Cells), Points

# ---- group: height
min_height = Slider(2.04, range=0..10)
construct_domain = ConstructDomain(DomainStart=min_height, DomainEnd=max_height_2)
list_length = ListLength(List=square.Cells)
random = Random(Range=construct_domain, Number=list_length, Seed=Slider(8, range=0..100))
unit_z = UnitZ(Factor=random)

# ----
move = Move(Geometry=square.Cells, Motion=unit_z)  # -> Geometry, Transform

# ---- group: x axis rotation
construct_domain_2 = ConstructDomain(DomainStart=expr("-x", x_rotation_2), DomainEnd=x_rotation_2)
list_length_2 = ListLength(List=square.Cells)
random_2 = Random(Range=construct_domain_2, Number=list_length_2, Seed=Slider(0, range=0..100))

# ---- group: y axis rotation
construct_domain_3 = ConstructDomain(DomainStart=expr("-x", y_rotation_2), DomainEnd=y_rotation_2)
list_length_3 = ListLength(List=square.Cells)
random_3 = Random(Range=construct_domain_3, Number=list_length_3, Seed=Slider(50, range=0..100))

# ----
is_planar = IsPlanar(Surface=move.Geometry, Interior=True)  # -> Planar, Plane
deconstruct_plane = DeconstructPlane(Plane=is_planar.Plane)  # -> Origin, XAxis, YAxis, ZAxis
rotate_3d = Rotate3D(Geometry=move.Geometry, Angle=degrees(random_2), Center=deconstruct_plane.Origin, Axis=deconstruct_plane.XAxis)  # -> Geometry, Transform
rotate_3d_2 = Rotate3D(Geometry=rotate_3d.Geometry, Angle=degrees(random_3), Center=deconstruct_plane.Origin, Axis=deconstruct_plane.YAxis)  # -> Geometry, Transform
curve = Curve(simplify(graft(rotate_3d_2.Geometry)))
curve_2 = Curve(simplify(graft(square.Cells)))
loft = Loft(
    Curves=[curve_2, curve],
    Options={Adjust=False, Closed=False, LoftEnds=0, LoftSimp=0, LoftType=0, Rebuild=10, Refit=0.01})
cap_holes = CapHoles(Brep=loft)
context_bake = ContextBake(Geometry=cap_holes)
custom_preview = CustomPreview(
    Geometry=cap_holes,
    Material={diffuse=RGB(221, 160, 221), emission=RGB(66, 48, 66), shine=0.5, specular=RGB(255, 255, 255), transparency=0})
